# Grasshopper definition packing.gh (Grasshopper 1.0.7)

genes = GenePool(Decimals=2, Maximum=1, Minimum=0, Value=[1, 0.16, 0.79, 0.87, 0.38, 0.86, 0.85, 0.26, 0.17, 1])
genes_2 = GenePool(Decimals=2, Maximum=1, Minimum=0, Value=[0.99, 0.06, 0.88, 0.95, 0.12, 1, 0.94, 0.35, 0.73, 0.9])

python = GhPythonScript()  # -> out, data_path
# ---------- python: Python ----------
import sys
import Rhino.Geometry as rh

### GET LOCAL PATH
gh_path = ghenv.Component.OnPingDocument().FilePath.split("G:\My Drive\_GSAPP Classes\Fall\Design Intelligence\Final Project - Packing")
print "Local GH path: {}".format(gh_path)

data_path = "\\".join(gh_path[:-1] + ["rooms.json"])
# ---------- end python ----------
file = ReadFile(F=python.data_path, PerLineParse=False)  # -> C
#   port F: Uri of file to read
# ---------- file: VB line parser ----------
    action = GH_LineParserAction.Include
    Return line

    'Parse the line and return some data that represents the line.
    'If the line cannot be parsed, you can return Nothing and
    'assign a different action.
    'The default implementation is to just return the line itself.
    'If you return types that implement IGH_Goo, this component
    'will work substantially faster.
# ---------- end file ----------
python_2 = GhPythonScript(file=file)  # -> out, names, areas, adjacencies
# ---------- python_2: Python ----------
import json

items = json.loads(file)

names = [item["name"] for item in items]
areas = [item["area"] for item in items]

adjacencies = {}

for item in items:
    adjacencies[item["name"]] = item["adjacency"]

adjacencies = json.dumps(adjacencies)
# ---------- end python_2 ----------

pi = Pi(Factor=1)
remap = RemapNumbers(Value=genes, Source=Domain(0, 1), Target="0 to 10")  # -> Mapped, Clipped
remap_2 = RemapNumbers(Value=genes_2, Source=Domain(0, 1), Target="0 to 10")  # -> Mapped, Clipped
panel = Panel(python_2.adjacencies)
division = Division(A=python_2.areas, B=pi)
pt = ConstructPoint(XCoordinate=remap.Mapped, YCoordinate=remap_2.Mapped, ZCoordinate=0)
sqrt = SquareRoot(Value=division)
python_3 = GhPythonScript(
    pts=pt,
    max_iters=Slider(750, range=0..1000),
    alpha=Slider(0.68, range=0..1),
    radii=sqrt,
    adjacencies=python_2.adjacencies)  # -> out, pts, circles, iters; inputs pts: list of Point3d, max_iters: Int32, radii: list
# ---------- python_3: Python ----------
import sys
import Rhino.Geometry as rh
import json

### GET LOCAL PATH
gh_path = ghenv.Component.OnPingDocument().FilePath.split("G:\My Drive\_GSAPP Classes\Fall\Design Intelligence\Final Project - Packing")
print "Local GH path: {}".format(gh_path)

#scripts_path = "\\".join(gh_path[:-1] + ["_scripts"])
#if scripts_path not in sys.path: sys.path.append(scripts_path)

import packing
reload(packing)

###

adjacencies = json.loads(adjacencies)

print(adjacencies)

circles, iters = packing.run(pts, radii, max_iters, alpha, adjacencies)
# ---------- end python_3 ----------
panel_2 = Panel(python_3.iters)
bbox = BoundingBox(Content=python_3.circles, Plane=PlaneXY(0, 0, 0), UnionBox=True)  # -> Box, Box_2
vec2pt = Vector2Pt(PointA=pt, PointB=python_3.pts, Unitize=False)  # -> Vector, Length
tag = TextTag(Location=python_3.pts, Text=python_2.names)
wires = BrepWireframe(Brep=bbox.Box, Density=-1)
area = Area(Geometry=bbox.Box)  # -> Area, Centroid
vdis = VectorDisplay(Anchor=pt, Vector=vec2pt.Vector)
galapagos = Galapagos(fitness=area, gene=[genes, genes_2])
